# Grasshopper definition server.gh (Grasshopper 1.0.8)
# plug-ins: RhinoCodePluginGH

trigger = Trigger(Interval=1000, TimerInterval=1000, Target=py3)  # disabled

# ---- group: reading from cloud
py3 = Python3Script()  # -> out, a, plns, ids; inputs listen: Boolean
# ---------- py3: Python ----------
import urllib.request
import json
import Rhino.Geometry as rg


url = "https://idlworshop-default-rtdb.firebaseio.com/mocapdata.json"

try:
    with urllib.request.urlopen(url) as response:
        json_str = response.read().decode("utf-8") 
        a = json_str
except Exception as e:
    a = str(e)

markers = json.loads(json_str)

plns = []
ids = []
for i in range(len(markers)):
    id_number = markers[i]["id"]
    ids.append(id_number)

    pos = markers[i]["pos"]
    xaxis = markers[i]["rot"]["x"]
    yaxis = markers[i]["rot"]["y"]
    zaxis = markers[i]["rot"]["z"]
    origin = rg.Point3d(*pos)
    x_vec = rg.Vector3d(*xaxis)
    y_vec = rg.Vector3d(*yaxis)
    z_vec = rg.Vector3d(*zaxis)

    # flattten all planes
    origin.Z = 0
    x_vec.Z = 0
    z_vec.Z = 0

    pln = rg.Plane(origin, x_vec, y_vec)
    plns.append(pln)
# ---------- end py3 ----------

# ----
panel = Panel(py3.ids)

# ---- group: class
wall_class = Python3Script()  # -> out
# ---------- wall_class: Python ----------
import scriptcontext as sc
import Rhino.Geometry as rg
import Rhino

class Wall:
    def __init__(self, order, pln):
        self.order = order
        self.pln = pln
        self.default_length = 10
        self.tolerance = 0.1
        self.line = None
        self.trim = None
        self.seg = None
        self.seg_door = None
        self._init()
    
    def _init(self):
        pt0 = self.pln.Origin + self.pln.XAxis * self.default_length
        pt1 = self.pln.Origin - self.pln.XAxis * self.default_length
        self.line =  rg.Line(pt0, pt1)
        self.trim = self.line
        self.seg = [self.trim]
    
    def _trim(self, l1, l2, origin):
        result, a, b = rg.Intersect.Intersection.LineLine(l1, l2, self.tolerance, False)
        if result == 1 and -self.tolerance <= a <= 1 + self.tolerance \
        and -self.tolerance <= b <= 1 +self.tolerance:
            pt = l1.PointAt(a)
            seg1 = rg.Line(l1.From, pt)
            seg2 = rg.Line(pt, l1.To)
            trimmed = seg1
            t1 = seg1.ClosestParameter(origin)
            t1 = max(0, min(1, t1))
            t2 = seg2.ClosestParameter(origin)
            t2 = max(0, min(1, t2))
            if seg1.PointAt(t1).DistanceTo(origin) > seg2.PointAt(t2).DistanceTo(origin):
                trimmed = seg2
            return trimmed
        else:
            return l1
                
    def trim_by(self, wall2):
        self.trim = self._trim(self.trim, wall2.trim, self.pln.Origin)
        self.seg = [self.trim]

    def _insert(self, l1, l2, direction, width, reverse):
        t = l1.ClosestParameter(l2.From)
        pt_start = l1.PointAt(t)
        if not reverse:
            pt_end = pt_start + direction * width
            seg1 = rg.Line(l1.From, pt_end)
            seg2 = rg.Line(pt_start, pt_end)
            seg3 = rg.Line(pt_start, l1.To)
        else:
            pt_end = pt_start - direction * width
            seg1 = rg.Line(l1.From, pt_start)
            seg2 = rg.Line(pt_end, pt_start)
            seg3 = rg.Line(pt_end, l1.To)
        return seg1, seg2, seg3

    def insert_door(self, door, reverse):
        result = self._insert(self.trim, door.line, self.pln.XAxis, door.width, reverse)
        self.seg = [result[0], result[2]]
        self.seg_door = result[1]


class Door:
    def __init__(self, pln):
        self.pln = pln
        self.width = 1
        self.tolerance = 0.2
        self.angle_tolerance = 10
        self.line = None
        self._init()

    def _init(self):
        pt1 = self.pln.Origin + self.pln.XAxis * self.width
        self.line =  rg.Line(self.pln.Origin, pt1)
    
    def is_on_wall(self, wall):
        t = wall.trim.ClosestParameter(self.pln.Origin)
        t = max(0, min(1, t))
        pt_close = wall.trim.PointAt(t)
        if self.pln.Origin.DistanceTo(pt_close) <= self.tolerance:
            angle_rad = rg.Vector3d.VectorAngle(self.pln.XAxis, wall.pln.XAxis)
            angle_deg = Rhino.RhinoMath.ToDegrees(angle_rad)
            if abs(angle_deg) < self.angle_tolerance:
                return True, False
            elif abs(angle_deg) > 180 - self.angle_tolerance:
                return True, True
            else:
                return False, False
        else:
            return False, False


class Furniture:
    def __init__(self, number, pln):
        self.number = number
        self.pln = pln


sc.sticky["Wall"] = Wall
sc.sticky["Door"] = Door
sc.sticky["Furniture"] = Furniture
# ---------- end wall_class ----------

# ----
plane = Plane([PlaneXY(-3.282968473, -3, 0), Plane(origin=(-3.6, 2.091652383, 0), x=(0, 1, 0), y=(-1, 0, 0)), PlaneXY(2.995913389, 2.7, 0), Plane(origin=(3.6, -2.473506813, 0), x=(0, 1, 0), y=(-1, 0, 0))])
py3_2 = Python3Script(fixed_plns=plane, plns=py3.plns, ids=py3.ids)  # -> out, wall_lines, door_lines, furniture_plns; inputs fixed_plns: list of Plane, plns: list of Plane, ids: list of Int32
# ---------- py3_2: Python ----------
import scriptcontext as sc
import Rhino.Geometry as rg

Wall = sc.sticky["Wall"]
Door = sc.sticky["Door"] 

walls = []
doors = []
h0 = []
h1 = []
h2 = []
h3 = []

for i in range(len(fixed_plns)): #hierachy 0 wall
    wall = Wall(0, fixed_plns[i])
    walls.append(wall)
    h0.append(wall)

for i in range(len(ids)):
    if ids[i] == 1:
        wall = Wall(1, plns[i])
        walls.append(wall)
        h1.append(wall)

    elif ids[i] == 2: # hierachy 2 wall
        wall = Wall(2, plns[i])
        walls.append(wall)
        h2.append(wall)

    elif ids[i] == 3:
        wall = Wall(3, plns[i])
        walls.append(wall)
        h3.append(wall)

    elif ids[i] == 4 or ids[i] == 5: # door
        door = Door(plns[i])
        doors.append(door)

# trim walls among same hierachy
walls_sorted = [h0, h1, h2]
for k in range(len(walls_sorted)):
    for i in range(len(walls_sorted[k])):
        for j in range(i+1, len(walls_sorted[k])):
            walls_sorted[k][i].trim_by(walls_sorted[k][j])
            walls_sorted[k][j].trim_by(walls_sorted[k][i])

# for i in range(len(h0)):
#     for j in range(i+1, len(h0)):
#         h0[j].trim_by(h0[i])
#         h0[i].trim_by(h0[j])

# trim walls by higher hierachy
w1 = h1[0]
w2 = h2[0]
w3 = h3[0]
for w in h0:
    w1.trim_by(w)
    w2.trim_by(w)
    w3.trim_by(w)

w2.trim_by(w1)
w3.trim_by(w1)
w3.trim_by(w2)

for d in doors:
    for w in walls:
        bool1, bool2 = d.is_on_wall(w)
        if d.is_on_wall(w)[0]:
            w.insert_door(d, bool2)

wall_lines = []
door_lines = []
for w in walls:
    wall_lines.extend(w.seg)
    if w.seg_door is not None:
        door_lines.append(w.seg_door)
# ---------- end py3_2 ----------
python_3_script = Python3Script(ids=py3.ids, plns=py3.plns)  # -> out, bed, sofa, kitchen, desk, stool1, stool2, person; inputs ids: list of Int32, plns: list of Plane
# ---------- python_3_script: Python ----------
dic = {
    1: "wall1",
    2: "wall2",
    3: "wall3",
    4: "door1",
    5: "door2",
    6: "bed",
    7: "sofa",
    8: "kitchen",
    9: "desk",
    10: "stool1",
    13: "stool2",
    14: "person"
}


bed = plns[ids.index(6)]
sofa = plns[ids.index(7)]
kitchen = plns[ids.index(8)]
desk = plns[ids.index(9)]
stool1 = plns[ids.index(10)]
stool2= plns[ids.index(13)]
person= plns[ids.index(14)]
# ---------- end python_3_script ----------
crv = Curve(py3_2.wall_lines)
crv_2 = Curve(py3_2.door_lines)
xy = XYPlane(Origin=Point(0, 0, 0))
panel_2 = Panel(python_3_script.person)
Z = UnitZ(Factor=Slider(1.6, range=0..10))
crv_3 = Curve(py3_2.door_lines)

Z_2 = UnitZ(Factor="2.1")
move = Move(Geometry=crv_2, Motion=Z_2)  # -> Geometry, Transform
vec = Vector(unitize(move.Geometry))
rotate = Rotate(Geometry=vec, Angle=1.570796327, Plane=PlaneXY(0, 0, 0))  # -> Geometry, Transform
neg = Negative(Value="0.1")
multiplication = Multiplication(A=rotate.Geometry, B="0.1")
multiplication_2 = Multiplication(A=rotate.Geometry, B=neg)
move_2 = Move(Geometry=move.Geometry, Motion=multiplication)  # -> Geometry, Transform
move_3 = Move(Geometry=move.Geometry, Motion=multiplication_2)  # -> Geometry, Transform
edgesrf = EdgeSurface(CurveA=move_2.Geometry, CurveB=move_3.Geometry)
Z_3 = UnitZ(Factor="0.9")
extr = Extrude(Base=edgesrf, Direction=Z_3)

vec_2 = Vector(unitize(crv))
rotate_2 = Rotate(Geometry=vec_2, Angle=1.570796327, Plane=PlaneXY(0, 0, 0))  # -> Geometry, Transform
neg_2 = Negative(Value="0.1")
multiplication_3 = Multiplication(A=rotate_2.Geometry, B="0.1")
multiplication_4 = Multiplication(A=rotate_2.Geometry, B=neg_2)
move_4 = Move(Geometry=crv, Motion=multiplication_3)  # -> Geometry, Transform
move_5 = Move(Geometry=crv, Motion=multiplication_4)  # -> Geometry, Transform
edgesrf_2 = EdgeSurface(CurveA=move_4.Geometry, CurveB=move_5.Geometry)
Z_4 = UnitZ(Factor="3")
extr_2 = Extrude(Base=edgesrf_2, Direction=Z_4)

move_6 = Move(Geometry=python_3_script.person, Motion=Z)  # -> Geometry, Transform

# ---- group: sofa
mesh = Mesh(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)

# ---- group: desk
mesh_2 = Mesh(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)

# ---- group: stool1
mesh_3 = Mesh(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)

# ---- group: kitchen
mesh_4 = Mesh(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)

# ---- group: stool2
mesh_5 = Mesh(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)

# ---- group: bed
mesh_6 = Mesh(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)

# ----
mesh_7 = Mesh(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)
orient = Orient(Geometry=mesh_6, Source=xy, Target=python_3_script.bed)  # -> Geometry, Transform
orient_2 = Orient(Geometry=mesh, Source=xy, Target=python_3_script.sofa)  # -> Geometry, Transform
orient_3 = Orient(Geometry=mesh_4, Source=xy, Target=python_3_script.kitchen)  # -> Geometry, Transform
orient_4 = Orient(Geometry=mesh_2, Source=xy, Target=python_3_script.desk)  # -> Geometry, Transform
orient_5 = Orient(Geometry=mesh_3, Source=xy, Target=python_3_script.stool1)  # -> Geometry, Transform
orient_6 = Orient(Geometry=mesh_5, Source=xy, Target=python_3_script.stool2)  # -> Geometry, Transform
orient_7 = Orient(Geometry=mesh_7, Source=xy, Target=move_6.Geometry)  # -> Geometry, Transform
preview = CustomPreview(Geometry=orient_7.Geometry, Material=ColourSwatch(SwatchColor=RGB(255, 0, 0)))
mesh_8 = Mesh([orient.Geometry, orient_2.Geometry, orient_3.Geometry, orient_4.Geometry, orient_5.Geometry, orient_6.Geometry])
split = SplitList(List=extr_2, Index=Slider(3, range=0..10))  # -> ListA, ListB
brep = Brep([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])
brep_2 = Brep(split.ListB)
brep_3 = Brep(flatten([extr, brep_2, brep]))

mesh_9 = MeshBrep(
    Brep=brep_3,
    Settings={GridMaxCount=0, GridMinCount=16, JaggedSeams=False, MaxEdgeLength=0, MinEdgeLength=0.0001, MinTolerance=0, Refine=True, RefineAngle=0, RelativeTolerance=0.65, SimplePlanes=True, Tolerance=0})
mjoin = MeshJoin(Meshes=mesh_9)
toggle = BooleanToggle(True)
py3_3 = Python3Script(mesh=mjoin)  # -> out, a, b; inputs mesh: Mesh, send: Boolean
# ---------- py3_3: Python ----------
import urllib.request
import json


vertices = []
for v in mesh.Vertices:
    vertices.append([v.X, v.Y, v.Z])

faces = []
for f in mesh.Faces:
    if f.IsTriangle:
        faces.append([f.A, f.B, f.C])
    elif f.IsQuad:
        faces.append([f.A, f.B, f.C, f.D])

data = {
    "vertices": vertices,
    "faces": faces
}

json_str = json.dumps(data)

url = "https://idlworshop-default-rtdb.firebaseio.com/mesh.json"

json_str = json_str.encode('utf-8')

req = urllib.request.Request(url, data=json_str, method="PUT")
req.add_header('Content-Type', 'application/json') 

try:
    with urllib.request.urlopen(req) as response:
        result = response.read().decode()
        a = "Success"
        b = result
except Exception as e:
    a = "Error"
    b = str(e)
# ---------- end py3_3 ----------

trigger_2 = Trigger(Interval=1000, TimerInterval=1000, Target=py3_3)  # disabled
panel_3 = Panel(mjoin)
panel_4 = Panel(py3_3.a)
panel_5 = Panel(py3_3.b)
